# Grasshopper definition Xylo_Example Input for Recursive Aggregation.gh (Grasshopper 1.0.7)
# plug-ins: Kangaroo2 Components

number_slider = Slider(1.1, range=0..1.5)
multiplication = Multiplication(A=number_slider, B=Slider(0.7, range=0..1))

panel = Panel("reconfigure")
number_slider_2 = Slider(71, range=0..100)

panel_2 = Panel("branch growth")

unit_z = UnitZ(Factor=Slider(2.5, range=0..10))
number_slider_3 = Slider(5, range=0..10)

panel_3 = Panel("Deformation")

division = Division(A=number_slider_3, B=Slider(2, range=0..10))
unit_z_2 = UnitZ(Factor=division)
unit_z_3 = UnitZ(Factor=Slider(500, range=20..500))
division_2 = Division(A=number_slider_3, B=Slider(2, range=0..10))
unit_z_4 = UnitZ(Factor=division_2)
division_3 = Division(A=number_slider_3, B=Slider(2, range=0..10))
unit_z_5 = UnitZ(Factor=Slider(500, range=20..500))
unit_z_6 = UnitZ(Factor=division_3)
unit_z_7 = UnitZ(Factor=Slider(500, range=20..500))

# ---- group: LARGE CIRCLE
unit_x = UnitX(Factor=Slider(200, range=0..1000))
circle_cnr = CircleCNR(Center="0,0,0", Normal=Vector(0, 0, 1), Radius=Slider(40, range=0..1000))

# ----
area = Area(Geometry=circle_cnr)  # -> Area, Centroid

# ---- group: SMALL CIRCLE
number_slider_4 = Slider(1, range=1..1.5)
circle_cnr_2 = CircleCNR(Center=area.Centroid, Normal=Vector(0, 0, 1), Radius=Slider(30, range=0..1000))
scale = Scale(Geometry=circle_cnr_2, Center=area.Centroid, Factor=multiplication)  # -> Geometry, Transform
scale_nu = ScaleNU(Geometry=scale.Geometry, Plane=area.Centroid, ScaleX=Slider(1.2, range=0..10), ScaleY=1, ScaleZ=1)  # -> Geometry, Transform
boundary_surfaces = BoundarySurfaces(Edges=scale_nu.Geometry)

# ---- group: LARGE CIRCLE (continued)
scale_2 = Scale(Geometry=circle_cnr, Center=area.Centroid, Factor=number_slider)  # -> Geometry, Transform
scale_nu_2 = ScaleNU(Geometry=scale_2.Geometry, Plane=area.Centroid, ScaleX=1, ScaleY=Slider(1.66, range=0..10), ScaleZ=1)  # -> Geometry, Transform

# ---- group: RANDOM POINTS [LARGE CNR]
populate_geometry = PopulateGeometry(Geometry=scale_nu_2.Geometry, Count=Slider(3, range=0..10), Seed=number_slider_2)

# ---- group: RANDOM POINTS [SMALL CNR]
populate_geometry_2 = PopulateGeometry(Geometry=boundary_surfaces, Count=Slider(1, range=0..1), Seed=number_slider_2)

# ----
list_item = ListItem(List=populate_geometry, Index=0, Wrap=True)  # -> Item, Item1, Item2
line = Line(StartPoint=list_item.Item1, EndPoint=populate_geometry_2)
line_2 = Line(StartPoint=list_item.Item2, EndPoint=populate_geometry_2)
line_3 = Line(StartPoint=list_item.Item, EndPoint=populate_geometry_2)
curve_middle = CurveMiddle(Curve=line_3)
curve_middle_2 = CurveMiddle(Curve=line)
curve_middle_3 = CurveMiddle(Curve=line_2)
horizontal_frame = HorizontalFrame(Curve=line_3, Parameter=curve_middle)
horizontal_frame_2 = HorizontalFrame(Curve=line_2, Parameter=curve_middle_3)
horizontal_frame_3 = HorizontalFrame(Curve=line, Parameter=curve_middle_2)
deconstruct_plane = DeconstructPlane(Plane=horizontal_frame)  # -> Origin, XAxis, YAxis, ZAxis
deconstruct_plane_2 = DeconstructPlane(Plane=horizontal_frame_2)  # -> Origin, XAxis, YAxis, ZAxis
deconstruct_plane_3 = DeconstructPlane(Plane=horizontal_frame_3)  # -> Origin, XAxis, YAxis, ZAxis
line_sdl = LineSDL(Start=curve_middle, Direction=deconstruct_plane.YAxis, Length=Slider(32, range=30..60))
line_sdl_2 = LineSDL(Start=curve_middle_2, Direction=deconstruct_plane_3.YAxis, Length=Slider(31, range=30..60))
line_sdl_3 = LineSDL(Start=curve_middle_3, Direction=deconstruct_plane_2.YAxis, Length=Slider(37, range=30..60))
end_points = EndPoints(Curve=line_sdl)  # -> Start, End
end_points_2 = EndPoints(Curve=line_3)  # -> Start, End
end_points_3 = EndPoints(Curve=line_2)  # -> Start, End
end_points_4 = EndPoints(Curve=line_sdl_3)  # -> Start, End
end_points_5 = EndPoints(Curve=line)  # -> Start, End
end_points_6 = EndPoints(Curve=line_sdl_2)  # -> Start, End
curve_closest_point = CurveClosestPoint(Point=[end_points_6.Start, end_points_5.Start], Curve=line)  # -> Point, Parameter, Distance
curve_closest_point_2 = CurveClosestPoint(Point=[end_points_4.Start, end_points_3.Start], Curve=line_2)  # -> Point, Parameter, Distance
curve_closest_point_3 = CurveClosestPoint(Point=[end_points.Start, end_points_2.Start], Curve=line_3)  # -> Point, Parameter, Distance
shatter = Shatter(Curve=line_3, Parameters=curve_closest_point_3.Parameter)
shatter_2 = Shatter(Curve=line, Parameters=curve_closest_point.Parameter)
shatter_3 = Shatter(Curve=line_2, Parameters=curve_closest_point_2.Parameter)

# ---- group: MULTIPIPE SPINE
multipipe = MultiPipe(
    Curves=flatten([shatter, shatter_2, shatter_3, line_sdl, line_sdl_2, line_sdl_3]),
    NodeSize=Slider(1.2, range=0..10),
    EndOffset=Slider(12, range=0..100),
    StrutSize=Slider(1, range=0..1),
    Segment=0,
    KinkAngle=0.6,
    CubeFit=0,
    Caps=0)
offset_curve = OffsetCurve(Curve=scale_nu_2.Geometry, Distance=Slider(25, range=0..100), Corners=1)
unit_z_8 = UnitZ(Factor=Slider(10, range=0..10))
cap_holes = CapHoles(Brep=multipipe)
boundary_surfaces_2 = BoundarySurfaces(Edges=offset_curve)
negative = Negative(Value=unit_z_8)
extrude = Extrude(Base=boundary_surfaces_2, Direction=negative)
solid_difference = SolidDifference(BrepsA=cap_holes, BrepsB=extrude)

# ---- group: BRANCHES / SECONDARY BRANCH
point = Point(end_points_4.End)
point_2 = Point(end_points.End)
point_3 = Point(end_points_6.End)

# ----
brep = Brep(extrude)

# ---- group: BRANCHES / PRIMARY BRANCH
point_4 = Point(end_points_2.Start)
point_5 = Point(end_points_5.Start)
point_6 = Point(end_points_3.Start)

# ----
relay = Relay([point, point_4, point_5, point_6, point_2, point_3])

# ---- group: SMALL NODES
sphere = Sphere(Base=relay, Radius=Slider(6, range=0..10))
scale_nu_3 = ScaleNU(Geometry=sphere, Plane=PlaneXY(0, 0, 0), ScaleX=1, ScaleY=1, ScaleZ=Slider(0.45, range=0..1))  # -> Geometry, Transform
move = Move(Geometry=scale_nu_3.Geometry, Motion=unit_z)  # -> Geometry, Transform

# ---- group: NODES - XY PLANE
brep_2 = Brep(brep)
solid_difference_2 = SolidDifference(BrepsA=move.Geometry, BrepsB=brep_2)
solid_union = SolidUnion(Breps=[solid_difference_2, solid_difference])

# ----
move_2 = Move(Geometry=line_3, Motion=unit_z_2)  # -> Geometry, Transform
end_points_7 = EndPoints(Curve=move_2.Geometry)  # -> Start, End
mesh_brep = MeshBrep(
    Brep=solid_union,
    Settings={GridMaxCount=0, GridMinCount=16, JaggedSeams=False, MaxEdgeLength=0, MinEdgeLength=0.0001, MinTolerance=0, Refine=True, RefineAngle=0, RelativeTolerance=0.65, SimplePlanes=True, Tolerance=0})
horizontal_frame_4 = HorizontalFrame(Curve=move_2.Geometry, Parameter=end_points_7.End)
point_7 = Point(end_points_7.End)
move_3 = Move(Geometry=point_7, Motion=unit_z_3)  # -> Geometry, Transform
deconstruct_plane_4 = DeconstructPlane(Plane=horizontal_frame_4)  # -> Origin, XAxis, YAxis, ZAxis
negative_2 = Negative(Value=deconstruct_plane_4.XAxis)
move_4 = Move(Geometry=line, Motion=unit_z_4)  # -> Geometry, Transform
arc_sed = ArcSED(Start=point_7, End=move_3.Geometry, Direction=negative_2)  # -> Arc, Plane, Radius
end_points_8 = EndPoints(Curve=move_4.Geometry)  # -> Start, End
horizontal_frame_5 = HorizontalFrame(Curve=move_4.Geometry, Parameter=end_points_8.End)
bend_deform = BendDeform(Geometry=mesh_brep, BendingArc=arc_sed.Arc)
move_5 = Move(Geometry=end_points_8.End, Motion=unit_z_5)  # -> Geometry, Transform
move_6 = Move(Geometry=line_2, Motion=unit_z_6)  # -> Geometry, Transform
deconstruct_plane_5 = DeconstructPlane(Plane=horizontal_frame_5)  # -> Origin, XAxis, YAxis, ZAxis
negative_3 = Negative(Value=deconstruct_plane_5.XAxis)
arc_sed_2 = ArcSED(Start=end_points_8.End, End=move_5.Geometry, Direction=negative_3)  # -> Arc, Plane, Radius
end_points_9 = EndPoints(Curve=move_6.Geometry)  # -> Start, End
horizontal_frame_6 = HorizontalFrame(Curve=move_6.Geometry, Parameter=end_points_9.End)
move_7 = Move(Geometry=end_points_9.End, Motion=unit_z_7)  # -> Geometry, Transform
deconstruct_plane_6 = DeconstructPlane(Plane=horizontal_frame_6)  # -> Origin, XAxis, YAxis, ZAxis
bend_deform_2 = BendDeform(Geometry=bend_deform, BendingArc=arc_sed_2.Arc)
negative_4 = Negative(Value=deconstruct_plane_6.XAxis)
arc_sed_3 = ArcSED(Start=end_points_9.End, End=move_7.Geometry, Direction=negative_4)  # -> Arc, Plane, Radius
bend_deform_3 = BendDeform(Geometry=bend_deform_2, BendingArc=arc_sed_3.Arc)
custom_preview = CustomPreview(Geometry=bend_deform_3, Material=ColourSwatch(SwatchColor=RGB(183, 162, 254)))
