# Grasshopper definition Xylo__Recursive Aggregation.gh (Grasshopper 1.0.7)
# plug-ins: Kangaroo2 Components, Pufferfish

number_slider = Slider(1.1, range=0..1.5)
multiplication = Multiplication(A=number_slider, B=Slider(0.7, range=0..1))
number_slider_2 = Slider(45, range=0..100)
panel = Panel("cener lines")
panel_2 = Panel("wasp aggregate geometry")
unit_z = UnitZ(Factor=Slider(300, range=-1000..1000))
unit_z_2 = UnitZ(Factor=Slider(100, range=-1000..1000))
unit_z_3 = UnitZ(Factor=Slider(200, range=-1000..1000))
panel_3 = Panel("building connection top")
panel_4 = Panel("builcing connection bottom")
unit_z_4 = UnitZ(Factor=Slider(2.5, range=0..10))
panel_5 = Panel("wasp")

# ---- group: LARGE CIRCLE
unit_x = UnitX(Factor=Slider(200, range=0..1000))
circle_cnr = CircleCNR(Center="0,0,0", Normal=Vector(0, 0, 1), Radius=Slider(40, range=0..1000))

# ----
area = Area(Geometry=circle_cnr)  # -> Area, Centroid

# ---- group: SMALL CIRCLE
number_slider_3 = Slider(1, range=1..1.5)
circle_cnr_2 = CircleCNR(Center=area.Centroid, Normal=Vector(0, 0, 1), Radius=Slider(30, range=0..1000))
scale = Scale(Geometry=circle_cnr_2, Center=area.Centroid, Factor=multiplication)  # -> Geometry, Transform
scale_nu = ScaleNU(Geometry=scale.Geometry, Plane=area.Centroid, ScaleX=Slider(1.2, range=0..10), ScaleY=1, ScaleZ=1)  # -> Geometry, Transform
boundary_surfaces = BoundarySurfaces(Edges=scale_nu.Geometry)

# ---- group: LARGE CIRCLE (continued)
scale_2 = Scale(Geometry=circle_cnr, Center=area.Centroid, Factor=number_slider)  # -> Geometry, Transform
scale_nu_2 = ScaleNU(Geometry=scale_2.Geometry, Plane=area.Centroid, ScaleX=1, ScaleY=Slider(1.66, range=0..10), ScaleZ=1)  # -> Geometry, Transform

# ---- group: RANDOM POINTS [LARGE CNR]
populate_geometry = PopulateGeometry(Geometry=scale_nu_2.Geometry, Count=Slider(3, range=0..10), Seed=number_slider_2)

# ---- group: RANDOM POINTS [SMALL CNR]
populate_geometry_2 = PopulateGeometry(Geometry=boundary_surfaces, Count=Slider(1, range=0..1), Seed=number_slider_2)

# ----
list_item = ListItem(List=populate_geometry, Index=0, Wrap=True)  # -> Item, Item1, Item2
line = Line(StartPoint=list_item.Item1, EndPoint=populate_geometry_2)
line_2 = Line(StartPoint=list_item.Item2, EndPoint=populate_geometry_2)
line_3 = Line(StartPoint=list_item.Item, EndPoint=populate_geometry_2)
curve_middle = CurveMiddle(Curve=line_3)
curve_middle_2 = CurveMiddle(Curve=line)
curve_middle_3 = CurveMiddle(Curve=line_2)
horizontal_frame = HorizontalFrame(Curve=line_3, Parameter=curve_middle)
horizontal_frame_2 = HorizontalFrame(Curve=line_2, Parameter=curve_middle_3)
horizontal_frame_3 = HorizontalFrame(Curve=line, Parameter=curve_middle_2)
deconstruct_plane = DeconstructPlane(Plane=horizontal_frame)  # -> Origin, XAxis, YAxis, ZAxis
deconstruct_plane_2 = DeconstructPlane(Plane=horizontal_frame_2)  # -> Origin, XAxis, YAxis, ZAxis
deconstruct_plane_3 = DeconstructPlane(Plane=horizontal_frame_3)  # -> Origin, XAxis, YAxis, ZAxis
line_sdl = LineSDL(Start=curve_middle, Direction=deconstruct_plane.YAxis, Length=Slider(39, range=30..60))
line_sdl_2 = LineSDL(Start=curve_middle_2, Direction=deconstruct_plane_3.YAxis, Length=Slider(40, range=30..60))
line_sdl_3 = LineSDL(Start=curve_middle_3, Direction=deconstruct_plane_2.YAxis, Length=Slider(40, range=30..60))
end_points = EndPoints(Curve=line_sdl)  # -> Start, End
end_points_2 = EndPoints(Curve=line_3)  # -> Start, End
end_points_3 = EndPoints(Curve=line_2)  # -> Start, End
end_points_4 = EndPoints(Curve=line_sdl_3)  # -> Start, End
end_points_5 = EndPoints(Curve=line)  # -> Start, End
end_points_6 = EndPoints(Curve=line_sdl_2)  # -> Start, End
curve_closest_point = CurveClosestPoint(Point=[end_points_6.Start, end_points_5.Start], Curve=line)  # -> Point, Parameter, Distance
curve_closest_point_2 = CurveClosestPoint(Point=[end_points_4.Start, end_points_3.Start], Curve=line_2)  # -> Point, Parameter, Distance
curve_closest_point_3 = CurveClosestPoint(Point=[end_points.Start, end_points_2.Start], Curve=line_3)  # -> Point, Parameter, Distance
shatter = Shatter(Curve=line_3, Parameters=curve_closest_point_3.Parameter)
shatter_2 = Shatter(Curve=line, Parameters=curve_closest_point.Parameter)
shatter_3 = Shatter(Curve=line_2, Parameters=curve_closest_point_2.Parameter)

end_points_7 = EndPoints(Curve=line_3)  # -> Start, End
end_points_8 = EndPoints(Curve=line)  # -> Start, End
end_points_9 = EndPoints(Curve=line_2)  # -> Start, End
# extending the initial lines to accomodate puck
end_points_10 = EndPoints(Curve=line_sdl)  # -> Start, End
end_points_11 = EndPoints(Curve=line_sdl_3)  # -> Start, End
end_points_12 = EndPoints(Curve=line_sdl_2)  # -> Start, End
point = Point(end_points_7.Start)
point_2 = Point(end_points_8.Start)
point_3 = Point(end_points_9.Start)
point_4 = Point(end_points_10.End)
point_5 = Point(end_points_11.End)
point_6 = Point(end_points_12.End)
horizontal_frame_4 = HorizontalFrame(Curve=line_3, Parameter=point)
horizontal_frame_5 = HorizontalFrame(Curve=line_2, Parameter=point_3)
horizontal_frame_6 = HorizontalFrame(Curve=line, Parameter=point_2)
horizontal_frame_7 = HorizontalFrame(Curve=line_sdl, Parameter=point_4)
horizontal_frame_8 = HorizontalFrame(Curve=line_sdl_3, Parameter=point_5)
horizontal_frame_9 = HorizontalFrame(Curve=line_sdl_2, Parameter=point_6)
number_slider_4 = Slider(-6, range=-10..0)
negative = Negative(Value=number_slider_4)
deconstruct_plane_4 = DeconstructPlane(Plane=horizontal_frame_5)  # -> Origin, XAxis, YAxis, ZAxis
deconstruct_plane_5 = DeconstructPlane(Plane=horizontal_frame_4)  # -> Origin, XAxis, YAxis, ZAxis
deconstruct_plane_6 = DeconstructPlane(Plane=horizontal_frame_6)  # -> Origin, XAxis, YAxis, ZAxis
deconstruct_plane_7 = DeconstructPlane(Plane=horizontal_frame_7)  # -> Origin, XAxis, YAxis, ZAxis
deconstruct_plane_8 = DeconstructPlane(Plane=horizontal_frame_8)  # -> Origin, XAxis, YAxis, ZAxis
deconstruct_plane_9 = DeconstructPlane(Plane=horizontal_frame_9)  # -> Origin, XAxis, YAxis, ZAxis
line_sdl_4 = LineSDL(Start=point, Direction=deconstruct_plane_5.XAxis, Length=number_slider_4)
line_sdl_5 = LineSDL(Start=point_3, Direction=deconstruct_plane_4.XAxis, Length=number_slider_4)
line_sdl_6 = LineSDL(Start=point_4, Direction=deconstruct_plane_7.XAxis, Length=negative)
line_sdl_7 = LineSDL(Start=point_2, Direction=deconstruct_plane_6.XAxis, Length=number_slider_4)
line_sdl_8 = LineSDL(Start=point_5, Direction=deconstruct_plane_8.XAxis, Length=negative)
line_sdl_9 = LineSDL(Start=point_6, Direction=deconstruct_plane_9.XAxis, Length=negative)
join_curves = JoinCurves(Curves=[line_sdl_4, line_3], Preserve=False)
join_curves_2 = JoinCurves(Curves=[line_2, line_sdl_5], Preserve=False)
join_curves_3 = JoinCurves(Curves=[line, line_sdl_7], Preserve=False)
join_curves_4 = JoinCurves(Curves=[line_sdl, line_sdl_6], Preserve=False)
join_curves_5 = JoinCurves(Curves=[line_sdl_3, line_sdl_8], Preserve=False)
join_curves_6 = JoinCurves(Curves=[line_sdl_2, line_sdl_9], Preserve=False)

end_points_13 = EndPoints(Curve=[line_sdl_6, line_sdl_9, line_sdl_8])  # -> Start, End
end_points_14 = EndPoints(Curve=[line_sdl_5, line_sdl_7, line_sdl_4])  # -> Start, End

number_slider_5 = Slider(6, range=0..10)
negative_2 = Negative(Value=number_slider_5)
offset_curve = OffsetCurve(Curve=join_curves_4, Plane=PlaneXY(0, 0, 0), Distance=number_slider_5, BothSides=negative_2, Kinks=0, CapType=1)
offset_curve_2 = OffsetCurve(Curve=join_curves_6, Plane=PlaneXY(0, 0, 0), Distance=number_slider_5, BothSides=negative_2, Kinks=0, CapType=1)
offset_curve_3 = OffsetCurve(Curve=join_curves_5, Plane=PlaneXY(0, 0, 0), Distance=number_slider_5, BothSides=negative_2, Kinks=0, CapType=1)
offset_curve_4 = OffsetCurve(Curve=join_curves, Plane=PlaneXY(0, 0, 0), Distance=number_slider_5, BothSides=negative_2, Kinks=0, CapType=1)
offset_curve_5 = OffsetCurve(Curve=join_curves_3, Plane=PlaneXY(0, 0, 0), Distance=number_slider_5, BothSides=negative_2, Kinks=0, CapType=1)
offset_curve_6 = OffsetCurve(Curve=join_curves_2, Plane=PlaneXY(0, 0, 0), Distance=number_slider_5, BothSides=negative_2, Kinks=0, CapType=1)
trim_with_regions = TrimWithRegions(Curve=flatten(offset_curve_6), Regions=flatten([offset_curve_5, offset_curve_4, offset_curve_3]))  # -> Inside, Outside
trim_with_regions_2 = TrimWithRegions(Curve=flatten(offset_curve_4), Regions=flatten([offset_curve_5, offset_curve_6, offset_curve]))  # -> Inside, Outside
trim_with_regions_3 = TrimWithRegions(Curve=flatten(offset_curve_5), Regions=flatten([offset_curve_4, offset_curve_6, offset_curve_2]))  # -> Inside, Outside
trim_with_regions_4 = TrimWithRegions(Curve=offset_curve_3, Regions=offset_curve_6)  # -> Inside, Outside
trim_with_regions_5 = TrimWithRegions(Curve=offset_curve, Regions=offset_curve_4)  # -> Inside, Outside
trim_with_regions_6 = TrimWithRegions(Curve=offset_curve_2, Regions=offset_curve_5)  # -> Inside, Outside
curve = Curve(trim_with_regions.Outside)
curve_2 = Curve(trim_with_regions_2.Outside)
curve_3 = Curve(trim_with_regions_3.Outside)
curve_4 = Curve(trim_with_regions_4.Outside)
curve_5 = Curve(trim_with_regions_5.Outside)
curve_6 = Curve(trim_with_regions_6.Outside)
number_slider_6 = Slider(5, range=0..10)
join_curves_7 = JoinCurves(Curves=flatten([curve_5, curve_6, curve_4, curve_2, curve_3, curve]), Preserve=False)
boundary_surfaces_2 = BoundarySurfaces(Edges=join_curves_7)
unit_z_5 = UnitZ(Factor=number_slider_6)
unit_z_6 = UnitZ(Factor=number_slider_6)
move = Move(Motion=unit_z_5)  # -> Geometry, Transform
move_2 = Move(Motion=unit_z_5)  # -> Geometry, Transform
number_slider_7 = Slider(0, range=0..1000)
extrude = Extrude(Base=boundary_surfaces_2, Direction=unit_z_6)
rotate = Rotate(Geometry=move_2.Geometry, Angle=degrees(number_slider_7), Plane=end_points_14.Start)  # -> Geometry, Transform
rotate_2 = Rotate(Geometry=move.Geometry, Angle=degrees(number_slider_7), Plane=end_points_13.Start)  # -> Geometry, Transform

division = Division(A=number_slider_6, B=Slider(2, range=0..10))
unit_z_7 = UnitZ(Factor=division)
move_3 = Move(Geometry=line_3, Motion=unit_z_7)  # -> Geometry, Transform
unit_z_8 = UnitZ(Factor=number_slider_6)
end_points_15 = EndPoints(Curve=move_3.Geometry)  # -> Start, End
point_7 = Point([end_points_14.Start, end_points_13.Start])
horizontal_frame_10 = HorizontalFrame(Curve=move_3.Geometry, Parameter=end_points_15.End)
move_4 = Move(Geometry=point_7, Motion=unit_z_8)  # -> Geometry, Transform
point_8 = Point(end_points_15.End)
move_5 = Move(Geometry=point_8, Motion=unit_z)  # -> Geometry, Transform
deconstruct_plane_10 = DeconstructPlane(Plane=horizontal_frame_10)  # -> Origin, XAxis, YAxis, ZAxis
negative_3 = Negative(Value=deconstruct_plane_10.XAxis)
division_2 = Division(A=number_slider_6, B=Slider(2, range=0..10))
arc_sed = ArcSED(Start=point_8, End=move_5.Geometry, Direction=negative_3)  # -> Arc, Plane, Radius
unit_z_9 = UnitZ(Factor=division_2)
move_6 = Move(Geometry=line, Motion=unit_z_9)  # -> Geometry, Transform

# ---- group: MULTIPIPE SPINE
multipipe = MultiPipe(
    Curves=flatten([shatter, shatter_2, shatter_3, line_sdl, line_sdl_2, line_sdl_3]),
    NodeSize=Slider(1.2, range=0..10),
    EndOffset=Slider(12, range=0..100),
    StrutSize=Slider(1, range=0..1),
    Segment=0,
    KinkAngle=0.6,
    CubeFit=0,
    Caps=0)
offset_curve_7 = OffsetCurve(Curve=scale_nu_2.Geometry, Distance=Slider(25, range=0..100), Corners=1)
unit_z_10 = UnitZ(Factor=Slider(10, range=0..10))
cap_holes = CapHoles(Brep=multipipe)
boundary_surfaces_3 = BoundarySurfaces(Edges=offset_curve_7)
negative_4 = Negative(Value=unit_z_10)
extrude_2 = Extrude(Base=boundary_surfaces_3, Direction=negative_4)
solid_difference = SolidDifference(BrepsA=cap_holes, BrepsB=extrude_2)

# ----
bend_deform = BendDeform(Geometry=extrude, BendingArc=arc_sed.Arc)
bend_deform_2 = BendDeform(Geometry=point_7, BendingArc=arc_sed.Arc)
end_points_16 = EndPoints(Curve=move_6.Geometry)  # -> Start, End
bend_deform_3 = BendDeform(Geometry=move_4.Geometry, BendingArc=arc_sed.Arc)
division_3 = Division(A=number_slider_6, B=Slider(2, range=0..10))
unit_z_11 = UnitZ(Factor=division_3)
horizontal_frame_11 = HorizontalFrame(Curve=move_6.Geometry, Parameter=end_points_16.End)
move_7 = Move(Geometry=end_points_16.End, Motion=unit_z_2)  # -> Geometry, Transform
deconstruct_plane_11 = DeconstructPlane(Plane=horizontal_frame_11)  # -> Origin, XAxis, YAxis, ZAxis
move_8 = Move(Geometry=line_2, Motion=unit_z_11)  # -> Geometry, Transform
negative_5 = Negative(Value=deconstruct_plane_11.XAxis)
arc_sed_2 = ArcSED(Start=end_points_16.End, End=move_7.Geometry, Direction=negative_5)  # -> Arc, Plane, Radius
end_points_17 = EndPoints(Curve=move_8.Geometry)  # -> Start, End
horizontal_frame_12 = HorizontalFrame(Curve=move_8.Geometry, Parameter=end_points_17.End)
move_9 = Move(Geometry=end_points_17.End, Motion=unit_z_3)  # -> Geometry, Transform
bend_deform_4 = BendDeform(Geometry=bend_deform_3, BendingArc=arc_sed_2.Arc)
bend_deform_5 = BendDeform(Geometry=bend_deform, BendingArc=arc_sed_2.Arc)
bend_deform_6 = BendDeform(Geometry=bend_deform_2, BendingArc=arc_sed_2.Arc)
deconstruct_plane_12 = DeconstructPlane(Plane=horizontal_frame_12)  # -> Origin, XAxis, YAxis, ZAxis
negative_6 = Negative(Value=deconstruct_plane_12.XAxis)
arc_sed_3 = ArcSED(Start=end_points_17.End, End=move_9.Geometry, Direction=negative_6)  # -> Arc, Plane, Radius
bend_deform_7 = BendDeform(Geometry=bend_deform_4, BendingArc=arc_sed_3.Arc)
bend_deform_8 = BendDeform(Geometry=bend_deform_5, BendingArc=arc_sed_3.Arc)
bend_deform_9 = BendDeform(Geometry=bend_deform_6, BendingArc=arc_sed_3.Arc)

# ---- group: BRANCHES / SECONDARY BRANCH
point_9 = Point(end_points_4.End)
point_10 = Point(end_points.End)
point_11 = Point(end_points_6.End)

# ----
brep = Brep(extrude_2)

# ---- group: BRANCHES / PRIMARY BRANCH
point_12 = Point(end_points_2.Start)
point_13 = Point(end_points_5.Start)
point_14 = Point(end_points_3.Start)

# ----
brep_closest_point = BrepClosestPoint(Point=bend_deform_9, Brep=bend_deform_8)  # -> Point, Normal, Distance
negative_7 = Negative(Value=Slider(0.5, range=0..10))
circle_cnr_3 = CircleCNR(Center=brep_closest_point.Point, Normal=brep_closest_point.Normal, Radius=1)
amplitude = Amplitude(Vector=brep_closest_point.Normal, Amplitude=negative_7)
number_slider_8 = Slider(0.6, range=0..10)
move_10 = Move(Geometry=circle_cnr_3, Motion=amplitude)  # -> Geometry, Transform
amplitude_2 = Amplitude(Vector=brep_closest_point.Normal, Amplitude=number_slider_8)
construct_domain = ConstructDomain(DomainStart=Slider(0, range=0..100), DomainEnd=Slider(360, range=0..1000))
area_2 = Area(Geometry=move_10.Geometry)  # -> Area, Centroid
end_points_18 = EndPoints(Curve=move_10.Geometry)  # -> Start, End
random = Random(Range=construct_domain, Number=Slider(6, range=0..10), Seed=Slider(20, range=0..100))
extrude_3 = Extrude(Base=move_10.Geometry, Direction=amplitude_2)
line_4 = Line(StartPoint=area_2.Centroid, EndPoint=end_points_18.Start)
rotate_3d = Rotate3D(Geometry=line_4, Angle=degrees(random), Center=area_2.Centroid, Axis=brep_closest_point.Normal)  # -> Geometry, Transform
cap_holes_2 = CapHoles(Brep=extrude_3)
amplitude_3 = Amplitude(Vector=brep_closest_point.Normal, Amplitude=number_slider_8)
amplitude_4 = Amplitude(Vector=brep_closest_point.Normal, Amplitude=number_slider_8)
move_11 = Move(Geometry=rotate_3d.Geometry, Motion=amplitude_3)  # -> Geometry, Transform
move_12 = Move(Geometry=area_2.Centroid, Motion=amplitude_4)  # -> Geometry, Transform

brep_closest_point_2 = BrepClosestPoint(Point=bend_deform_7, Brep=bend_deform_8)  # -> Point, Normal, Distance
negative_8 = Negative(Value=Slider(0.5, range=0..10))
circle_cnr_4 = CircleCNR(Center=brep_closest_point_2.Point, Normal=brep_closest_point_2.Normal, Radius=1)
amplitude_5 = Amplitude(Vector=brep_closest_point_2.Normal, Amplitude=negative_8)
number_slider_9 = Slider(0.6, range=0..10)
move_13 = Move(Geometry=circle_cnr_4, Motion=amplitude_5)  # -> Geometry, Transform
amplitude_6 = Amplitude(Vector=brep_closest_point_2.Normal, Amplitude=number_slider_9)
construct_domain_2 = ConstructDomain(DomainStart=Slider(0, range=0..100), DomainEnd=Slider(360, range=0..1000))
area_3 = Area(Geometry=move_13.Geometry)  # -> Area, Centroid
end_points_19 = EndPoints(Curve=move_13.Geometry)  # -> Start, End
random_2 = Random(Range=construct_domain_2, Number=Slider(6, range=0..10), Seed=Slider(53, range=0..100))
extrude_4 = Extrude(Base=move_13.Geometry, Direction=amplitude_6)
line_5 = Line(StartPoint=area_3.Centroid, EndPoint=end_points_19.Start)
cap_holes_3 = CapHoles(Brep=extrude_4)
rotate_3d_2 = Rotate3D(Geometry=line_5, Angle=degrees(random_2), Center=area_3.Centroid, Axis=brep_closest_point_2.Normal)  # -> Geometry, Transform
amplitude_7 = Amplitude(Vector=brep_closest_point_2.Normal, Amplitude=number_slider_9)
amplitude_8 = Amplitude(Vector=brep_closest_point_2.Normal, Amplitude=number_slider_9)
move_14 = Move(Geometry=rotate_3d_2.Geometry, Motion=amplitude_7)  # -> Geometry, Transform
move_15 = Move(Geometry=area_3.Centroid, Motion=amplitude_8)  # -> Geometry, Transform
solid_union = SolidUnion(Breps=[cap_holes_3, bend_deform_8])

relay = Relay([point_9, point_12, point_13, point_14, point_10, point_11])

# ---- group: SMALL NODES
sphere = Sphere(Base=relay, Radius=Slider(6, range=0..10))
scale_nu_3 = ScaleNU(Geometry=sphere, Plane=PlaneXY(0, 0, 0), ScaleX=1, ScaleY=1, ScaleZ=Slider(0.45, range=0..1))  # -> Geometry, Transform
move_16 = Move(Geometry=scale_nu_3.Geometry, Motion=unit_z_4)  # -> Geometry, Transform

# ----
conndir = Wasp_ConnectionFromDirection(GEO=solid_union, CEN=move_15.Geometry, UP=move_14.Geometry)  # -> CONN, PLN_OUT; inputs CEN: list of Point3d, UP: list of Curve, T: list; plug-in component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
rotate_plane = RotatePlane(Plane=conndir.PLN_OUT, Angle=degrees(Slider(85, range=0..100)))
connpln = Wasp_ConnectionFromPlane(PLN=rotate_plane)  # -> CONN, PLN_OUT; inputs PLN: list of Plane, T: list; plug-in component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
solid_union_2 = SolidUnion(Breps=[cap_holes_2, bend_deform_8, cap_holes_3])
conndir_2 = Wasp_ConnectionFromDirection(GEO=solid_union_2, CEN=move_12.Geometry, UP=move_11.Geometry)  # -> CONN, PLN_OUT; inputs CEN: list of Point3d, UP: list of Curve, T: list; plug-in component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
rotate_plane_2 = RotatePlane(Plane=conndir_2.PLN_OUT, Angle=degrees(Slider(12, range=0..100)))
connpln_2 = Wasp_ConnectionFromPlane(PLN=rotate_plane_2)  # -> CONN, PLN_OUT; inputs PLN: list of Plane, T: list; plug-in component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
merge = Merge(Data1=conndir_2.CONN, Data2=connpln_2.CONN, Data3=conndir.CONN, Data4=connpln.CONN)

# ---- group: NODES - XY PLANE
brep_2 = Brep(brep)
solid_difference_2 = SolidDifference(BrepsA=move_16.Geometry, BrepsB=brep_2)
solid_union_3 = SolidUnion(Breps=[solid_difference_2, solid_difference])

# ----
bend_deform_10 = BendDeform(Geometry=solid_union_3, BendingArc=arc_sed.Arc)
bend_deform_11 = BendDeform(Geometry=bend_deform_10, BendingArc=arc_sed_2.Arc)
bend_deform_12 = BendDeform(Geometry=bend_deform_11, BendingArc=arc_sed_3.Arc)
mesh_brep = MeshBrep(
    Brep=bend_deform_12,
    Settings={GridMaxCount=0, GridMinCount=16, JaggedSeams=False, MaxEdgeLength=0, MinEdgeLength=0.0001, MinTolerance=0, Refine=True, RefineAngle=0, RelativeTolerance=0.65, SimplePlanes=True, Tolerance=0})
attribute = Wasp_Attribute(ID="bendy", VAL=mesh_brep, TR=Toggle(True))  # -> ATTR; inputs VAL: list, TR: Boolean; plug-in component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
part = Wasp_BasicPart(NAME="xylo", GEO=solid_union_2, CONN=flatten(merge), ATTR=attribute)  # -> PART; inputs GEO: Mesh, CONN: list, ATTR: list; plug-in component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
rulegen = Wasp_RulesGenerator(PART=part)  # -> R; inputs PART: list, SELF_P: Boolean, SELF_C: Boolean, TYP: Boolean, GR: list; plug-in component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
stochasticaggregation = Wasp_StochasticAggregation(PART=flatten(part), N=Slider(100, range=0..1000), RULES=rulegen, RESET=Button())  # -> AGGR, PART_OUT; inputs PART: list, PREV: list, N: Int32, RULES: list, SEED: Int32, MODE: Int32, GC: list, RESET: Boolean; plug-in component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
getattr = Wasp_GetAttributeByName(PART=stochasticaggregation.PART_OUT, ID="bendy")  # -> VAL; plug-in component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
custom_preview = CustomPreview(Geometry=getattr, Material=ColourSwatch(SwatchColor=RGB(183, 162, 254)))
